# Dynamo graph Family-Placement_CAD.dyn "CADFamPlacement" (Dynamo 2.19.3.6394)
# packages: bimorphNodes 5.1.3

select_model_element = DSModelElementSelection()  # 1 picked in the model
code_block = CodeBlock { "x-balcony$0$100_Balcony Ellipse"; }
curvesFromCADLayers = CAD.CurvesFromCADLayers(importInstance=select_model_element, layerNames=code_block)
string_from_object = FromObject(object=curvesFromCADLayers.Curve)
code_block_2 = CodeBlock { "Arc"; }
contains = String.Contains(string=string_from_object, searchFor=code_block_2)
filterByBoolMask = List.FilterByBoolMask(list=curvesFromCADLayers.Curve, mask=contains)
centerPoint = Arc.CenterPoint(arc=filterByBoolMask.in)
